# Dynamo graph Eixos_Modulados.dyn (Dynamo 3.0.3.7597)

# group: Cria Eixos Modulados e cotados
# Prof: José Luis Menegoitto
# Escola Politécnica da UFRJ
views = Views("Nível 1")
quantidade_módulos_x = IntegerSlider(18, range=2..30 step 1)
dimensão_módulo_x = DoubleSlider(1, range=1..6 step 0.25)
razão_módulo_x = DoubleSlider(0.5, range=0.25..0.75 step 0.125)
valor_modular_em_x = IntegerSlider(4, range=1..5 step 1)
eixos_modulados = CodeBlock(vis=views, qx=quantidade_módulos_x, dx=dimensão_módulo_x, rx=razão_módulo_x, mx=valor_modular_em_x)
# ---------- eixos_modulados.designscript (25 lines) ----------
vis;
qx;
dx;
rx;
mx;
PAR  = "Name";
//--------------------------------------------------
ix   = 0..qx;
dex  = dx * rx;
Cx   = dx * ix + (ix%mx ? dex : 0);
//--------------------------------------------------
PX1  = Point.ByCoordinates (Cx,  10, 0);
PX2  = PX1.Translate       ( 0, -20, 0);
PX3  = PX1.Translate       ( 0, -22, 0);
//--------------------------------------------------
// Colocação de eixos com cotas
//--------------------------------------------------
nume = ix+1;
nome = ""+nume;
eix  = Grid.ByStartPointEndPoint ( PX1 , PX2 );
eix.SetParameterByName           ( PAR , nome);
//--------------------------------------------------
ldi  = Line.ByStartPointEndPoint ( PX3[0], PX3[-1]);
ref  = eix.Curve;
dim  = Dimension.ByElements ( vis,eix,ldi,"","" );
# ----------------------------------------
