# Dynamo graph PPE_Aula06b.dyn (Dynamo 2.18.1.5096)

# group: Função para marcação de treliças
# Escola Politécnica UFRJ.
# Prof. José Luis Menegotto
vão_total_da_treliça = DoubleSlider(10, range=10..20 step 0.25)
quantidade_de_módulos = DoubleSlider(12, range=4..20 step 4)
angulo = DoubleSlider(0, range=0..45 step 0.1)
altura_inicial_entre_banzos = DoubleSlider(1, range=1..2 step 0.1)
inverter_as_aguas = BoolSelector(false)
treliças_pratt_0_howe_1 = DoubleSlider(1, range=0..1 step 1)
marcação_das_barras_das_treliças = CodeBlock(vao=vão_total_da_treliça, qmo=quantidade_de_módulos, ang=angulo, sep=altura_inicial_entre_banzos, ina=inverter_as_aguas, tre=treliças_pratt_0_howe_1)
# ---------- marcação_das_barras_das_treliças.designscript (42 lines) ----------
vao;
qmo;
ang;
sep;
ina;
tre;
//-----------------------------------------------------
vx   = vao/2;
mx   = vao/qmo;
//-----------------------------------------------------
x1    = -vx..vx..mx;
x    = -vx..vx..#qmo+1;
inc  = Math.Tan( ang );
amax = sep + (vx * inc);
alp  = ina== 0 ?  x * inc : x * -inc;
altu = x  <  0 ? amax+alp : amax-alp;
//-----------------------------------------------------
// Pontos do Banzo inferior e superior
//-----------------------------------------------------
PTI  = Point.ByCoordinates( x , 0 , 0   );
PTS  = PTI.Translate      ( 0 , 0 , altu);
//-----------------------------------------------------
// Indices completo ic e as duas metades i1 e 12
//-----------------------------------------------------
ic   = 0     .. qmo   -1;
i1   = 0     .. qmo/2 -1;
i2   = qmo/2 .. qmo   -1;
//-----------------------------------------------------
// Os indices j e k são invertidos caso o sistema seja
// Pratt ou Howe
//-----------------------------------------------------
j    = tre==0?  i1 : i2;
k    = tre==0?  i2 : i1;
//-----------------------------------------------------
// Barras de Montantes, Banzo Inferior, Banzo Superior
// Diagonais esquerdas e Diagonais direitas
//-----------------------------------------------------
BMO  = Line.ByStartPointEndPoint ( PTI     , PTS       );
BBI  = Line.ByStartPointEndPoint ( PTI[ic] , PTI[ic+1] );
BBS  = Line.ByStartPointEndPoint ( PTS[ic] , PTS[ic+1] );
BDE  = Line.ByStartPointEndPoint ( PTS[j]  , PTI[j+1]  );
BDD  = Line.ByStartPointEndPoint ( PTI[k]  , PTS[k+1]  );
# ----------------------------------------
