# Dynamo graph Ponte_Saber.dyn (Dynamo 3.5.0.8297)

# group: Marcação de uma Obra de Arte Especial - Exercício para a Ponte do Saber UFRJ
# Autor: Prof. José Luis Menegotto
# Escola Politécnica da UFRJ
# Programa de Pós-graduação em Estruturas. Disciplina BIM.
largura = DoubleSlider(4.75, range=1..15 step 0.25)
profundidade = DoubleSlider(2.25, range=1..5 step 0.25)
altura = DoubleSlider(32.75, range=25..50 step 0.25)
altura_intermédia = DoubleSlider(3.75, range=1..10 step 0.25)
c1_em_y = DoubleSlider(0.25, range=0.1..0.45 step 0.05)
c2_em_y = DoubleSlider(0.1, range=0.1..0.45 step 0.05)
simetria_x_1_simétrico = DoubleSlider(0.25, range=-0.25..0.25 step 0.025)
simetria_y_1_simétrico = DoubleSlider(0.49, range=0.05..1 step 0.0025)
espessura_parede = DoubleSlider(0.25, range=0.05..0.5 step 0.05)
andar = Levels("Nível 2")
escalar_topo_1_seção_reta = DoubleSlider(0.3, range=0.2..1 step 0.05)
inclinar_0_vertical = DoubleSlider(7.65, range=0..20 step 0.05)
categoria_para_definir_o_mastro = Categories("OST_BridgeAbutments")
modelar_mastro_como_directshape = BoolSelector(false)
quantidade_de_estai = DoubleSlider(15, range=5..15 step 1)
largura_total_tabuleiro = DoubleSlider(12, range=10..15 step 0.25)
altura_do_tabuleiro = DoubleSlider(1.25, range=1..2 step 0.25)
espessura_do_tabuleiro = DoubleSlider(0.25, range=0.25..0.6 step 0.05)
distancia_inicial_dos_cabos = DoubleSlider(20, range=10..50 step 1)
distancia_final_dos_cabos = DoubleSlider(150, range=60..150 step 1)
seção_inferior_do_mastro = CodeBlock(l=largura, p=profundidade, hh=altura, hi=altura_intermédia, c1=c1_em_y, c2=c2_em_y, k=simetria_x_1_simétrico, j=simetria_y_1_simétrico, e=espessura_parede, an=andar, esc=escalar_topo_1_seção_reta, des=inclinar_0_vertical, cat=categoria_para_definir_o_mastro, mod=modelar_mastro_como_directshape, qes=quantidade_de_estai, lt=largura_total_tabuleiro, ht=altura_do_tabuleiro, et=espessura_do_tabuleiro, di=distancia_inicial_dos_cabos, df=distancia_final_dos_cabos)
# ---------- seção_inferior_do_mastro.designscript (39 lines) ----------
l;
p;
hh;
hi;
c1;
c2;
k;
j;
e;
an;
esc;
des;
cat;
mod;
qes;
lt;
ht;
et;
di;
df;

pa  = "Elevation";
i   = [2,3,4,13,19,17,15,7];
cot = an.SetParameterByName( pa , hh );
//---------------------------------------
x   = [ -0.50+k ,   0    ,     0.5+k ] * l;
y   = [  0.50,c1,c2,0,-c2,-c1,-0.5   ] * p;
//---------------------------------------
LP  = Point.ByCoordinates ( x<1>, y, 0 );
LV  = List.Flatten        ( LP , 1 )[i];
PO  = PolyCurve.ByPoints  ( LV , 1 );
Ei  = Line.ByBestFitThroughPoints(LV);

mas = Mastro (mod,PO,cat,esc,des,hh,hi,l);
Po1 = mas[0][1];
Po2 = mas[0][2];
cab = Estais (Po1, Po2, di, df, hi, qes);
ptc = List.Flatten(cab[3], 2);
Pista ( lt, ht , et , ptc );
# ----------------------------------------
solidifica_o_mastro = CodeBlock()
# ---------- solidifica_o_mastro.designscript (29 lines) ----------
//---------------------------------------------------
//  Verificar que o material "Concreto" exista
//---------------------------------------------------
def Mastro (mo, ge, c, es, de, hm, hi, l )
{
    //-------------------------------------------
    // Forma a matriz dos pontos da seção
    //-------------------------------------------
    z  = [-5   , hi ,  hm ,  hm+(hm/6) ];
    d  = [ 0.0 , 0  , -de , -de   ];
    e  = [ 0.0 , 0  ,  es ,  es/2 ];
    //-------------------------------------------
    // Posiciona as quatro seções do mastro.
    // Primeiro escala e depois desloca
    // para a altura usando os parâmetros
    // das listas z, d, e
    // valores z e podem ser parametrizados
    //-------------------------------------------
    Po = ge.Scale          ( e          );
    Se = Po.Translate      ( d  , 0 , z );
    So = Solid.ByRuledLoft ( Se , 1     );
    //-------------------------------------------
    // Cria DirectSape só se f = True
    //-------------------------------------------
    m  = Material.ByName("Concreto");
    n  = "Mastro";
    Di = mo ? DirectShape.ByGeometry(So,c,m,n):0;
    return [ Se, So, Di ];
};
# ----------------------------------------
marcação_de_estai = CodeBlock()
# ---------- marcação_de_estai.designscript (26 lines) ----------
//---------------------------------------------------
// Harpa de estai recebe duas Seções p q e quantidade
//---------------------------------------------------
def Estais( p , q , di, df, hi, n )
{
    p1  = PolyCurve.Points( p )[5];
    p2  = PolyCurve.Points( q )[5];
    p3  = Point.Translate ( p1, di   , 0, -hi);
    p4  = Point.Translate ( p3, df-di, 0,  0 );
    //---------------------------------------------
    // Posiciona eixo dos cabos no mastro (ex)
    //---------------------------------------------
    ex  = Line.ByStartPointEndPoint ( p1 , p2 );
    pm  = ex.PointAtParameter   ( 0.5 );
    ta  = ex.TangentAtParameter ( 0.0 );
    da  = ex.Length / 2.1;
    //---------------------------------------------
    // Posiciona harpa
    //---------------------------------------------
    h1 = Line.ByStartPointDirectionLength(pm,ta,da);
    h2 = Line.ByStartPointEndPoint       (p3,p4   );
    a1 = Line.PointAtParameter(h1 , 0..1..#n);
    a2 = Line.PointAtParameter(h2 , 0..1..#n);
    ca = Line.ByStartPointEndPoint( a1 , a2);
    return [ h1, h2 , a1, a2, ca ];
};
# ----------------------------------------
code_block = CodeBlock()
# ---------- code_block.designscript (31 lines) ----------
//---------------------------------------------------
//  Pista
//---------------------------------------------------
def Pista ( lt , ht , et , pt )
{
    o   = Point.Origin( );
    v   = Vector.YAxis( );
    PM  = Plane.ByOriginNormal ( o , v );
    //-----------------------------------------------
    // Forma a matriz dos pontos
    //-----------------------------------------------
    y   = [-0.5 , -0.25 , -0.125 ,  0.0     ] * lt;
    z   = [ 0.0 , -0.10 , -0.200 , -0.8 , -1] * ht;
    //-----------------------------------------------
    // Escolhe os pontos da matriz
    //-----------------------------------------------
    i   = [ 0 , 2 , 7 , 14 , 19 , 15 , 10 ];
    //-----------------------------------------------
    LP  = Point.ByCoordinates ( 0, y<1>, z );
    LF  = List.Flatten        ( LP , 1     );
    LV  = LF[i];
    TD  = PolyCurve.ByPoints  ( LV , 1     );
    TE  = TD.Mirror   (  PM  );
    OD  = TD.Offset   ( -et  );
    OE  = TE.Offset   ( -et  );
    PD  = TD.Translate( pt.AsVector ( ) );
    PE  = TE.Translate( pt.AsVector ( ) );
    DD  = OD.Translate( pt.AsVector ( ) );
    EE  = OE.Translate( pt.AsVector ( ) );
    return [ TD , TE , PD , PE , DD , EE ];
};
# ----------------------------------------
