# Dynamo graph Distribui_Elem_Parede.dyn "Selecionar_Paredes" (Dynamo 4.0.2.3852)

# group: Distribui Elemento em parede
# Disciplina BIM - Prof. José Luis Menegotto
# DEG/POLI/UFRJ
categories = Categories("OST_Walls")
all_elements_of_category = ElementsOfCategory(Category=categories)
categories_2 = Categories("OST_ElectricalFixtures")
all_elements_of_category_2 = ElementsOfCategory(Category=categories_2)
distribui_elemento_em_parede = CodeBlock(par=all_elements_of_category, ele=all_elements_of_category_2)
# ---------- distribui_elemento_em_parede.designscript (11 lines) ----------
par;
ele;
q   = List.Count(ele);
eix = par.GetLocation();
tom = ele.GetLocation();
dim = eix.Length;
dis = Math.Round (dim / (q+1), 2);
pin = eix.PointsAtEqualSegmentLength(q+1);
pfi = List.Flatten ( pin , 1 );
//------------------------------------------------
ele.SetLocation ( pfi );
# ----------------------------------------
