# Dynamo graph Mandala_Midi.dyn (Dynamo 2.17.0.3472)

code_block = CodeBlock { 0; }
MIDI_MIDI = Musica_2020.Musica_2020.MIDI_MIDI(n=code_block)
mandala_midi = CodeBlock(midi=MIDI_MIDI)
# ---------- mandala_midi.designscript (11 lines) ----------
midi;
a   = 0..360..6;
r1  = 30;
r2  = r1/4;
x   = r1<1> * Math.Cos ( a );
y   = r2<1> * Math.Sin ( a );
P   = Point.ByCoordinates( x , y , 0);
not = Math.Abs(Math.Floor( x ))+ 64;
dur = not/not * not%3 ? 55 : not%5 ? 65 : 45;
din = not/not * not%2 ? 127 : 120;
Musica_2020.Tocar_1Nota( midi , not , dur, din , 1, 9);
# ----------------------------------------
