# Dynamo graph Viaduto_Millau_2023.dyn (Dynamo 2.13.1.3887)

# group: Função comentada de marcação da estrutura do Viaduto Millau. Revit 2023.
# Escola Politécnica da UFRJ. Departamento de Expressão Gráfica.
# Disciplina: Desenho Computacional
# Autor: Prof. José Luis Menegotto
Z1 = DoubleSlider(0, range=0..100 step 0.1)
L = DoubleSlider(2350, range=1000..2500 step 50)
corda = DoubleSlider(46.1, range=1..150 step 0.1)
altura_mastro = DoubleSlider(89, range=80..200 step 0.5)
altura_pilone = DoubleSlider(244, range=100..260 step 1.5)
parametro_cabo_inferior = DoubleSlider(0.56, range=0.5..0.65 step 0.01)
parametro_cabo_superior = DoubleSlider(0.97, range=0.7..0.99 step 0.01)
deslocar_cabos = DoubleSlider(1, range=0..4 step 1)
viaduto_millau_marcação_da = CodeBlock(z1=Z1, longi=L, corda=corda, AltMastro=altura_mastro, AltPilone=altura_pilone, ei=parametro_cabo_inferior, es=parametro_cabo_superior, dc=deslocar_cabos)  # "Viaduto Millau - Marcação da estrutura."
# ---------- viaduto_millau_marcação_da.designscript (71 lines) ----------
z1;
longi;
corda;
AltMastro;
AltPilone;
ei;
es;
dc;
qe        = 11.0;
AltCaixao =  4.5;
Modulos   = 14.0;
ModulosX  = Modulos * 20;
AltPista  = AltPilone + AltCaixao;
AltPilone;
// ----------------------------------------------------
// Definição dos arcos da pista
// ----------------------------------------------------
p1      = Point.ByCoordinates ( 0       , 0     , z1 );
p2      = Point.ByCoordinates ( longi/2 , corda , z1 );
p3      = Point.ByCoordinates ( longi   , 0     , z1 );
Eixo    = Arc.ByThreePoints   ( p1 , p2 , p3         );
Pista   = Eixo.Translate      ( 0  , 0  , AltPista   );
// ----------------------------------------------------
// Segmentação dos módulos construtivos da pista
// ----------------------------------------------------
Comprim = Arc.Length ( Eixo );
CaixaoL = Comprim / ModulosX;
PtoPil1 = Arc.PointsAtEqualSegmentLength ( Eixo    , Modulos          );
PtoPil2 = List.TakeEveryNthItem          ( PtoPil1 , 2 , 1            );
PtoMast = Point.Translate                ( PtoPil2 , 0 , 0 , AltPista );
// ----------------------------------------------------
// Posicionamento dos pilones e dos mastros
// ----------------------------------------------------
Pilones = Line.ByStartPointDirectionLength(PtoPil2, Vector.ZAxis(), AltPilone);
Mastros = Line.ByStartPointDirectionLength(PtoMast, Vector.ZAxis(), AltMastro);
// ----------------------------------------------------
// Definição dos pontos dos Estais sobre os Mastros
// ----------------------------------------------------
p_MEsq   = List.TakeItems(ei..es..(es-ei)/(qe+2) , 11);
p_MDir   = List.Reverse  ( p_MEsq );
CabMa_E  = Line.PointAtParameter(Mastros<1>, p_MEsq);
CabMa_D  = Line.PointAtParameter(Mastros<1>, p_MDir);

Pini     = Mastros[0].StartPoint;
Caix     = Line.PointsAtSegmentLengthFromPoint(Pista , Pini , CaixaoL);
Norm     = Line.NormalAtParameter (Pista, Line.ParameterAtPoint(Pista, Caix));
// ----------------------------------------------------
// Segmentação da pista no sentido transversal
// ----------------------------------------------------
PTra1    = Line.ByStartPointDirectionLength ( Caix , Norm ,  16.02);
PTra2    = Line.ByStartPointDirectionLength ( Caix , Norm , -16.02);
// ----------------------------------------------------
// Divisão do Arco da Pista em Segmentos entre Mastros
// ----------------------------------------------------
pe       = List.Reverse ( 0..0.5..1/20 ) + (0.05 * dc);
pd       = List.Reverse ( 0.5..1..1/20 ) - (0.05 * dc);
Segmet  = Arc.SplitByPoints        ( Pista     , PtoPil1 );
SegEsq  = List.TakeEveryNthItem    ( Segmet    , 2  , 1  );
SegDir  = List.TakeEveryNthItem    ( Segmet    , 2  , 2  );
CabPi_E = Line.PointAtParameter    ( SegEsq<1> , pe      );
CabPi_D = Line.PointAtParameter    ( SegDir<1> , pd      );
// ----------------------------------------------------
// Traçado das Harpas
// ----------------------------------------------------
Estai_E = Line.ByStartPointEndPoint( CabMa_E   , CabPi_E );
Estai_D = Line.ByStartPointEndPoint( CabMa_D   , CabPi_D );
// ----------------------------------------------------
// Colocação dos Levels
// ----------------------------------------------------
Level.ByElevationAndName(AltPista , "Viaduto_Pista");
Level.ByElevationAndName(p1.Z     , "Viaduto_Base");
# ----------------------------------------

code_block = CodeBlock(altpilone=viaduto_millau_marcação_da.out12, P1=viaduto_millau_marcação_da.out14) { Level.ByElevationAndName(altpilone , "Pista"); Level.ByElevationAndName(P1.Z      , "Base"); }
